# Grasshopper definition inflateHops.gh (Grasshopper 1.0.8)
# plug-ins: Kangaroo2 Components

x = Slider(10, range=0..10)
y = Slider(5, range=0..10)
xdim = GetNumber(x, AtLeast=1, AtMost=1, Maximum=1.797693135e+308, Minimum=-1.797693135e+308, TreeAccess=False)
ydim = GetNumber(y, AtLeast=1, AtMost=1, Maximum=1.797693135e+308, Minimum=-1.797693135e+308, TreeAccess=False)
neg = Negative(Value=ydim)
neg_2 = Negative(Value=xdim)
dom = ConstructDomain(DomainStart=neg_2, DomainEnd=xdim)
dom_2 = ConstructDomain(DomainStart=neg, DomainEnd=ydim)
custom_mesh_settings = SettingsCustom(
    StitchSeams=True,
    SimplePlanes=False,
    Refine=True,
    MinCount="2000",
    MaxCount="2000",
    AspectRatio=20,
    MaxDistance=0,
    MaxAngle=20,
    MinEdge=0,
    MaxEdge=0)
rectangle = Rectangle(Plane=PlaneXY(0, 0, 0), XSize=dom, YSize=dom_2, Radius=0)  # -> Rectangle, Length
max_opening_radius = Slider(4, range=0..10)
min_opening_radius = Slider(1, range=0..1)
openings = Slider(10, range=5..10)
mesh = MeshBrep(Brep=rectangle.Rectangle, Settings=custom_mesh_settings)
nv = NakedVertices(Mesh=mesh)  # -> ClothedIndex, NakedIndex, ClothedPts, NakedPts
n_openings = GetInteger(openings, AtLeast=1, AtMost=1, Maximum=2147483647, Minimum=-2147483648, TreeAccess=False)
min_opening_radius_2 = GetNumber(min_opening_radius, AtLeast=1, AtMost=1, Maximum=1.797693135e+308, Minimum=-1.797693135e+308, TreeAccess=False)
max_opening_radius_2 = GetNumber(max_opening_radius, AtLeast=1, AtMost=1, Maximum=1.797693135e+308, Minimum=-1.797693135e+308, TreeAccess=False)
srf = Surface(rectangle.Rectangle)
lng = ListLength(List=nv.NakedPts)
dom_3 = ConstructDomain(DomainStart=0, DomainEnd=lng)
dom_4 = ConstructDomain(DomainStart=min_opening_radius_2, DomainEnd=max_opening_radius_2)
random = Random(Range=dom_4, Number=n_openings, Seed=2)
random_2 = Random(Range=dom_3, Number=n_openings, Seed=2)
item = ListItem(List=nv.NakedPts, Index=random_2, Wrap=True)
cir = Circle(Plane=item, Radius=random)
srfsplit = SurfaceSplit(Surface=srf, Curves=cir)
item_2 = ListItem(List=srfsplit, Index="-1", Wrap=True)
qrmesh = QuadRemesh(Geometry=item_2, Settings="4000")
nv_2 = NakedVertices(Mesh=qrmesh)  # -> ClothedIndex, NakedIndex, ClothedPts, NakedPts
crv = Curve(srf)
pt = Point(nv_2.NakedPts)
incurve = PointInCurve(Point=pt, Curve=crv)  # -> Relationship, Point
equals = Equality(FirstNumber=incurve.Relationship, SecondNumber=1)  # -> Equality, Inequality
cull = CullPattern(List=pt, CullPattern=invert(equals.Equality))
cull_2 = CullPattern(List=pt, CullPattern=equals.Equality)
merge = Merge(Data1=nv_2.ClothedPts, Data2=cull)
edgelength = Slider(1.5, range=0.5..2)

# ----
# inflate
pt_2 = Point(merge)

# ----
# anchor
pt_3 = Point(cull_2)

# ----
# mesh
mesh_2 = Mesh(qrmesh)

edgelength_2 = GetNumber(edgelength, AtLeast=1, AtMost=1, Maximum=1.797693135e+308, Minimum=-1.797693135e+308, TreeAccess=False)
edgelengths = EdgeLengths(Mesh=mesh_2, LengthFactor=edgelength_2, Strength="1000")
show = Show(G=mesh_2)
anchor = Anchor(Point=pt_3, Strength="1000")
load = Load(Point=pt_2, ForceVector=Vector(0, 0, 1), Weighting=1)
merge_2 = Merge(Data1=show, Data2=edgelengths, Data3=anchor, Data4=load)
zombiesolver = ZombieSolver(GoalObjects=merge_2, Threshold=1e-10, Tolerance=0.0001, MaxIterations=50000)  # -> I, V, O
item_3 = ListItem(List=zombiesolver.O, Index="0", Wrap=True)
mesh_3 = Mesh(item_3)
context_bake = ContextBake(Content=mesh_3)
